# Dynamo custom node All categories in document.dyf (Dynamo 3.5.2.8914)
# category: MEPover.Revit.Elements
# Retrieves all categories from the current document and splits them up in Model, Annotation, Analytic and Internal Categories

python_script = Python()  # CPython3
# ---------- python_script.python (43 lines) ----------
import clr

clr.AddReference("RevitAPI")
from Autodesk.Revit.DB import CategoryType

clr.AddReference("RevitNodes")
import Revit

clr.AddReference("RevitServices")
from RevitServices.Persistence import DocumentManager


def dynamo_category(category):
    """Convert a Revit API Category to a Dynamo Category"""
    return Revit.Elements.Category.ById(category.Id.Value)


def sort_list(item):
    return sorted(item, key=lambda i: i.Name)


doc = DocumentManager.Instance.CurrentDBDocument
categories = doc.Settings.Categories

model_cat = []
anno_cat = []
ana_cat = []
internal_cat = []

for category in categories:
    if category.CategoryType == CategoryType.Model:
        if category.SubCategories.Size > 0 or category.CanAddSubcategory:
            model_cat.append(dynamo_category(category))
        else:
            continue
    elif category.CategoryType == CategoryType.Annotation:
        anno_cat.append(dynamo_category(category))
    elif category.CategoryType == CategoryType.AnalyticalModel:
        ana_cat.append(dynamo_category(category))
    elif category.CategoryType == CategoryType.Internal:
        internal_cat.append(dynamo_category(category))

OUT = list(map(sort_list, (model_cat, anno_cat, ana_cat, internal_cat)))
# ----------------------------------------
code_block = CodeBlock(x=python_script) { x[0]; x[1]; x[2]; x[3]; }
Model_categories = Output(code_block.out0)
Annotation_categories = Output(code_block.out1)
Analytical_categories = Output(code_block.out2)
Internal_categories = Output(code_block.out3)
